# Grasshopper definition truchet_multiscale.gh (Grasshopper 0.9.80)

# ---- group: OUTPUT / CONTROLS
number_to_cull = Slider(0.809, range=0..1)
random_cull_seed = Slider(43, range=0..100)
grid_size = Slider(40, range=0..100)

# ---- group: Create the grid
number_slider = Slider(10, range=1..10)
int = Integer(grid_size)
division = Division(A=int, B=Slider(2, range=1..5))
sqgrid = Square(Plane=PlaneXY(0, 0, 0), Size=number_slider, ExtentX=int, ExtentY=division)  # -> Cells, Points
pcen = PolygonCenter(Polyline=sqgrid.Cells)  # -> CenterV, CenterE, flatten(CenterA)

# ----
points = PointList(Points=pcen.CenterA)
multiplication = Multiplication(A=int, B=Slider(2, range=1..5))

# ---- group: Move the pre-made geometry to each cell
pt = ConstructPoint(XCoordinate=expr("x/2", number_slider), YCoordinate=expr("x/2", number_slider), ZCoordinate=0)
crv = Curve([<curve referenced from the Rhino model> x24])
group = Group(Objects=crv)
vec2pt = Vector2Pt(PointA=pt, PointB=pcen.CenterA, Unitize=False)  # -> Vector, Length
move = Move(Geometry=group, Motion=vec2pt.Vector)  # -> flatten(Geometry), Transform

# ----
xy = XYPlane(Origin=pcen.CenterA)
number_to_cull_2 = Slider(2.032, range=0..5)
random_cull_seed_2 = Slider(30, range=0..100)

# ---- group: Create the grid
number_slider_2 = Slider(25, range=1..100)
division_2 = Division(A=int, B=Slider(2, range=1..5))
number_slider_3 = Slider(10, range=1..10)

# ----
multiplication_2 = Multiplication(A=division_2, B=Slider(2, range=1..5))

# ---- group: Create the grid (continued)
sqgrid_2 = Square(Plane=PlaneXY(0, 0, 0), Size=expr("x / 2", number_slider_3), ExtentX=multiplication, ExtentY=multiplication_2)  # -> Cells, Points
pcen_2 = PolygonCenter(Polyline=sqgrid_2.Cells)  # -> CenterV, CenterE, flatten(CenterA)

# ---- group: Move the pre-made geometry to each cell
vec = Vector(pcen.CenterA)
_2 = B(2)
crv_2 = Curve([<curve referenced from the Rhino model> x48])
pt_2 = ConstructPoint(XCoordinate=number_slider_3, YCoordinate=number_slider_3, ZCoordinate=0)
multiplication_3 = Multiplication(A=vec, B=_2)
group_2 = Group(Objects=crv_2)
vec2pt_2 = Vector2Pt(PointA=pt_2, PointB=multiplication_3, Unitize=False)  # -> Vector, Length
move_2 = Move(Geometry=group_2, Motion=vec2pt_2.Vector)  # -> flatten(Geometry), Transform

pt_3 = ConstructPoint(XCoordinate=expr("x/4", number_slider_3), YCoordinate=expr("x/4", number_slider_3), ZCoordinate=0)
crv_3 = Curve([<curve referenced from the Rhino model> x11])
group_3 = Group(Objects=crv_3)
vec2pt_3 = Vector2Pt(PointA=pt_3, PointB=pcen_2.CenterA, Unitize=False)  # -> Vector, Length
move_3 = Move(Geometry=group_3, Motion=vec2pt_3.Vector)  # -> flatten(Geometry), Transform

# ---- group: Randomly rotate every cell (a multiple of 90)
lng = ListLength(List=move_2.Geometry)
random = Random(Range=Domain(0, 1), Number=lng, Seed=Slider(6, range=0..10))
multiplication_4 = Multiplication(A=random, B=Slider(6, range=0..10))
addition = Addition(A=multiplication_4, B=Slider(1, range=0..1))
round = Round(Number=addition)  # -> Nearest, Floor, Ceiling
panel = Panel(round.Floor)
multiplication_5 = Multiplication(A=Slider(90, range=0..360), B=panel)

# ----
xy_2 = XYPlane(Origin=pcen_2.CenterA)
xy_3 = XYPlane(Origin=multiplication_3)
rotate = Rotate(Geometry=move_2.Geometry, Angle=degrees(multiplication_5), Plane=xy_3)  # -> Geometry, Transform

# ---- group: Remove a random amount of tiles
lng_2 = ListLength(List=rotate.Geometry)
multiplication_6 = Multiplication(A=lng_2, B=number_to_cull_2)
round_2 = Round(Number=multiplication_6)  # -> Nearest, Floor, Ceiling
dom = ConstructDomain(DomainStart=0, DomainEnd=expr("x-1", lng_2))
number_to_cull_3 = Integer(round_2.Floor)
random_seed = Integer(random_cull_seed_2)
random_2 = Random(Range=dom, Number=number_to_cull_3, Seed=random_seed)
round_3 = Round(Number=random_2)  # -> Nearest, Floor, Ceiling
panel_2 = Panel(round_3.Floor)

# ----
cull_i = CullIndex(List=rotate.Geometry, Indices=panel_2, Wrap=True)

# ---- group: OUTPUT
random_rot_seed_level_0 = Slider(4, range=0..10)
random_rot_seed_level_1 = Slider(8, range=0..10)

# ----
int_2 = Integer(random_rot_seed_level_1)

# ---- group: Randomly rotate every cell (a multiple of 90)
lng_3 = ListLength(List=move.Geometry)
int_3 = Integer(random_rot_seed_level_0)
random_3 = Random(Range=Domain(0, 1), Number=lng_3, Seed=int_3)
multiplication_7 = Multiplication(A=random_3, B=Slider(6, range=0..10))
addition_2 = Addition(A=multiplication_7, B=Slider(1, range=0..1))
round_4 = Round(Number=addition_2)  # -> Nearest, Floor, Ceiling
panel_3 = Panel(round_4.Floor)
multiplication_8 = Multiplication(A=Slider(90, range=0..360), B=panel_3)

lng_4 = ListLength(List=move_3.Geometry)
random_4 = Random(Range=Domain(0, 1), Number=lng_4, Seed=int_2)
multiplication_9 = Multiplication(A=random_4, B=Slider(6, range=0..10))
addition_3 = Addition(A=multiplication_9, B=Slider(1, range=0..1))
round_5 = Round(Number=addition_3)  # -> Nearest, Floor, Ceiling
panel_4 = Panel(round_5.Floor)
multiplication_10 = Multiplication(A=Slider(90, range=0..360), B=panel_4)

# ----
rotate_2 = Rotate(Geometry=move.Geometry, Angle=degrees(multiplication_8), Plane=xy)  # -> Geometry, Transform
rotate_3 = Rotate(Geometry=move_3.Geometry, Angle=degrees(multiplication_10), Plane=xy_2)  # -> Geometry, Transform

# ---- group: Remove a random amount of tiles
lng_5 = ListLength(List=rotate_2.Geometry)
multiplication_11 = Multiplication(A=lng_5, B=number_to_cull)
round_6 = Round(Number=multiplication_11)  # -> Nearest, Floor, Ceiling
dom_2 = ConstructDomain(DomainStart=0, DomainEnd=expr("x-1", lng_5))
number_to_cull_4 = Integer(round_6.Floor)
random_seed_2 = Integer(random_cull_seed)
random_5 = Random(Range=dom_2, Number=number_to_cull_4, Seed=random_seed_2)
round_7 = Round(Number=random_5)  # -> Nearest, Floor, Ceiling
panel_5 = Panel(round_7.Floor)

# ---- group: Get the {x,y} of the Level_0 Grid
indices = Integer(panel_5)
width = Integer(division)
mod = Modulus(A=indices, B=width)
integer_division = IntegerDivision(A=indices, B=width)
y = Integer(integer_division)
x = Integer(mod)

# ---- group: Covert to the {x,y} of the Level_1 Grid
_2_2 = B(2)
_2_3 = B(2)
_2_4 = B(2)
multiplication_12 = Multiplication(A=y, B=_2_2)
multiplication_13 = Multiplication(A=x, B=_2_3)
multiplication_14 = Multiplication(A=width, B=_2_4)
integer = Integer(multiplication_12)
width_2 = Integer(multiplication_14)
integer_2 = Integer(multiplication_13)
_1 = B(1)
addition_4 = Addition(A=integer, B=_1)
multiplication_15 = Multiplication(A=integer, B=width_2)
multiplication_16 = Multiplication(A=addition_4, B=width_2)
addition_5 = Addition(A=integer_2, B=multiplication_15)
addition_6 = Addition(A=integer_2, B=multiplication_16)

# ---- group: Composite the 2 Grids
item = ListItem(List=rotate_3.Geometry, Index=expr("x+1", addition_5), Wrap=False)
item_2 = ListItem(List=rotate_3.Geometry, Index=expr("x+1", addition_6), Wrap=False)
cull_i_2 = CullIndex(List=rotate_2.Geometry, Indices=panel_5, Wrap=True)
item_3 = ListItem(List=rotate_3.Geometry, Index=addition_5, Wrap=False)
item_4 = ListItem(List=rotate_3.Geometry, Index=addition_6, Wrap=False)

# ---- group: OUTPUT (continued)
final_geometry = Geometry([cull_i_2, item_3, item, item_4, item_2])
